vi "DC Voltage.gvi"   [LabVIEW NXG 5.1.0]
panel controls:
  "DONE": bool
  "ZATWIERDZ": bool
  "Manual Range": f64 = "1 V"(1)
  "Auto Range": bool = TRUE
  "Auto Zero": bool = TRUE
  "DCV Ratio": bool
  "Auto Impedance": bool
  "Aperture NPLC": f64 = "10 PLC"(10)
  "Aperture Time": f64 = 0.1
  "Aperture": bool = TRUE
  "DIG Option On/Off": bool
panel indicators:
  "resulting string": string
  "Auto Zero_2": bool
  "DCV Ratio_2": bool
  "Auto Impedance_2": bool
  "Manual Range_2": f64
  "Aperture NPLC_2": f64
  "Aperture Time_2": f64
uses:
  Agilent 3446X Series::Initialize.gvi
  Agilent 3446X Series::Configure Measurement.gvi
  Agilent 3446X Series::Configure Measurement Aperture.gvi
  Agilent 3446X Series::Configure Voltage.gvi
  Agilent 3446X Series::Auto Zero.gvi
  Agilent 3446X Series::Close.gvi
diagram:
  call "Initialize.gvi"(VISA resource name="TCPIP0::A-34461A-0000-2.local::inst0::INSTR") -> (VISA resource name out=w1, error out=w2)
  while {
    Quotient And Remainder(x=$"Aperture Time", y=2e-06) -> (floor(x/y)=w3, x-y*floor(x/y)=w4)
    Multiply(w4, 1000000) -> w5
    Round To Nearest(number=w5) -> w6
    To Signed 32 Bit Integer(number=w6) -> w7
    case (w7) {
      frame 0, Default {
        Multiply(2e-06, w3) -> w8
      }
      frame 1 {
        Multiply(2e-06, w3) -> w8
      }
      frame 2 {
        Add(1, w3) -> w9
        Multiply(2e-06, w9) -> w8
      }
    }
    Format Into String(formatString="%_6ps", initString="The Aperture Time has been set to: ", w8) -> w10
    $"resulting string" <- w10
    $"Aperture Time_2" <- $"Aperture Time"
    Property Node(instance in=reference to "Manual Range", "Disabled"=$"Auto Range")
    $"Manual Range_2" <- $"Manual Range"
    $"Aperture NPLC_2" <- $"Aperture NPLC"
    case ($"DIG Option On/Off") {
      frame False, Default {
        w11 = 0.0002
      }
      frame True {
        w11 = 2e-05
      }
    }
    Property Node(instance in=reference to "Aperture Time", "Minimum"=w11)
    case ($"DIG Option On/Off") {
      frame False, Default {
        w12 = [0, 1, 2]
      }
      frame True {
        w12 = i32[] []
      }
    }
    Property Node(instance in=reference to "Aperture NPLC", "DisabledIndexes"=w12)
    Property Node(instance in=reference to "Aperture Time", "Disabled"=$Aperture)
    case ($ZATWIERDZ) {
      frame False, Default {
        w13 = FALSE
      }
      frame True {
        case ($"Auto Range") {
          frame False, Default {
            Format Into String(formatString="%.0pV", initString="Range: ", $"Manual Range") -> w14
          }
          frame True {
            w14 = "Range: Auto"
          }
        }
        case ($Aperture) {
          frame False, Default {
            Format Into String(formatString="%_6ps", initString="Aperture Time: ", w8) -> w15
          }
          frame True {
            Format Into String(formatString="%#gPLC", initString="Aperture NPLC: ", $"Aperture NPLC") -> w15
          }
        }
        case ($"Auto Zero") {
          frame False, Default {
            w16 = "Auto Zero: Off"
          }
          frame True {
            w16 = "Auto Zero: On"
          }
        }
        case ($"Auto Impedance") {
          frame False, Default {
            w17 = "Input Z: 10MΩ"
          }
          frame True {
            w17 = "Input Z: Auto"
          }
        }
        case ($"DCV Ratio") {
          frame False, Default {
            w18 = "DCV Ratio: Off"
          }
          frame True {
            w18 = "DCV Ratio: On"
          }
        }
        Concatenate Strings("Your settings:", "\r\n", w14, "\r\n", w15, "\r\n", w16, "\r\n", w17, "\r\n", w18, "\r\n", "Are you sure you want to change settings?") -> w19
        Two Button Dialog(message=w19) -> (T Button?=w13)
      }
    }
    case (w13) {
      frame False, Default {
        w20 = _
        w21 = _
      }
      frame True {
        call "Configure Measurement.gvi"(VISA resource name=w1, error in=w2, measurement function="Voltage DC"(10)) -> (VISA resource name out=w22, error out=w23)
        case ($Aperture) {
          frame False, Default {
            call "Configure Measurement Aperture.gvi"(VISA resource name=w22, error in=w23, measurement function="Voltage DC"(10), enable aperture=TRUE, aperture time=w8) -> (VISA resource name out=w26, error out=w27)
            call "Configure Voltage.gvi"(VISA resource name=w26, error in=w27) -> (VISA resource name out=w24, error out=w25)
          }
          frame True {
            call "Configure Measurement Aperture.gvi"(VISA resource name=w22, error in=w23, measurement function="Voltage DC"(10), enable aperture=FALSE) -> (VISA resource name out=w28, error out=w29)
            call "Configure Voltage.gvi"(VISA resource name=w28, error in=w29, voltage integration time=$"Aperture NPLC") -> (VISA resource name out=w24, error out=w25)
          }
        }
        case ($"Auto Range") {
          frame False, Default {
            call "Configure Measurement.gvi"(manual range=$"Manual Range", VISA resource name=w24, error in=w25, measurement function="Voltage DC"(10), auto range=FALSE) -> (VISA resource name out=w30, error out=w31)
          }
          frame True {
            call "Configure Measurement.gvi"(VISA resource name=w24, error in=w25, measurement function="Voltage DC"(10), auto range=TRUE) -> (VISA resource name out=w30, error out=w31)
          }
        }
        case ($"Auto Zero") {
          frame False, Default {
            call "Auto Zero.gvi"(VISA resource name=w30, error in=w31, zero type="Voltage DC"(3), auto zero="Disable"(0)) -> (VISA resource name out=w32, error out=w33)
          }
          frame True {
            call "Auto Zero.gvi"(VISA resource name=w30, error in=w31, zero type="Voltage DC"(3), auto zero="Enable"(1)) -> (VISA resource name out=w32, error out=w33)
          }
        }
        case ($"Auto Impedance") {
          frame False, Default {
            call "Configure Voltage.gvi"(VISA resource name=w32, error in=w33, auto impedance=FALSE) -> (VISA resource name out=w20, error out=w21)
          }
          frame True {
            call "Configure Voltage.gvi"(VISA resource name=w32, error in=w33, auto impedance=TRUE) -> (VISA resource name out=w20, error out=w21)
          }
        }
      }
    }
    call "Close.gvi"(VISA resource name=w20, error in=w21)
    Not(x=$Aperture) -> w34
    Property Node(instance in=reference to "Aperture NPLC", "Disabled"=w34)
    $"Auto Zero_2" <- $"Auto Zero"
    $"Auto Impedance_2" <- $"Auto Impedance"
    $"DCV Ratio_2" <- $"DCV Ratio"
    stop if $DONE
  }
