vi "MAIN.gvi"   [LabVIEW NXG 5.1.0]
panel controls:
  "stop": bool
  "DC Voltage": bool
panel indicators:
  "name": string
diagram:
  while {
    case ($"DC Voltage") {
      frame False, Default { }
      frame True {
        Strip Path(path=path "D:\\LABVIEWPROJECTS\\GITLAB\\INZ0803\\DC Voltage.gvi") -> (name=w1)
        Open VI Reference(vi name=w1) -> (vi reference=w2)
        Run VI(auto dispose=TRUE, reference in=w2)
        $name <- w1
      }
    }
    stop if $stop
  }
